# Dynamo graph TestDefinition.dyn (Dynamo 0.9.1.3096)

code_block = CodeBlock { "C:\Users\mthumfart\Documents\GitHub\SketchUpSharp\SketchUp\SketchUpNET\Testfiles\TestModel.skp"; }
loadModel = SketchUpForDynamo.SketchUp.LoadModel(code_block)
