# Grasshopper definition TestDefinition.gh (Grasshopper 0.9.76)
# plug-ins: SketchUpSharp.Grasshopper

panel = Panel("C:\Users\mthumfart\Documents\GitHub\SketchUpNET\SketchUp\SketchUpNET\Testfiles\TestModel.skp")
crv = Curve([<curve referenced from the Rhino model> x2])
boundary = BoundarySurfaces(Edges=crv)
sketch_up_model = SketchUpModel(Path=panel)  # -> Surfaces, Layers, Instances
srf = Surface(sketch_up_model.Surfaces)
