# Dynamo graph TestReadDefinition.dyn (Dynamo 1.2.1.3083)

code_block = CodeBlock { "C:\Users\mthumfart\Documents\GitHub\SketchUpNET\SketchUp\SketchUpNET\Testfiles\TestModel.skp"; }
boolean = BoolSelector(true)
loadModel = SketchUpForDynamo.SketchUp.LoadModel(code_block, boolean)
getInstance = SketchUpForDynamo.SketchUp.GetInstance(loadModel.out2)
