# Dynamo graph TestWriteDefinition.dyn (Dynamo 0.9.1.3096)

code_block = CodeBlock { "C:/Users/mthumfart/Desktop/Untitled3.skp"; }
byCoordinates = Point.ByCoordinates()
code_block_2 = CodeBlock { 100; }
byCoordinates_2 = Point.ByCoordinates(x=code_block_2)
byCoordinates_3 = Point.ByCoordinates(x=code_block_2, y=code_block_2)
byCoordinates_4 = Point.ByCoordinates(y=code_block_2)
byCornerPoints = Rectangle.ByCornerPoints(byCoordinates, byCoordinates_2, byCoordinates_3, byCoordinates_4)
byPatch = Surface.ByPatch(byCornerPoints)
byStartPointEndPoint = Line.ByStartPointEndPoint(startPoint=byCoordinates, endPoint=byCoordinates_2)
create = List.Create(byStartPointEndPoint)
writeModel = SketchUpForDynamo.SketchUp.WriteModel(code_block, byPatch, create)
create_2 = List.Create(byPatch)
