# Dynamo graph Home.dyn (Dynamo 0.9.1.2992)

code_block = CodeBlock { "C:\Users\mthumfart\Documents\GitHub\SketchUpSharp\SketchUp\SketchupSharp\Testfiles\Untitled.skp"; }
loadModel = SketchUpSharp.Dynamo.SketchUp.LoadModel(code_block)
getInstance = SketchUpSharp.Dynamo.SketchUp.GetInstance(loadModel.out2)
watch = Watch(loadModel.out1)
