# Grasshopper definition test.gh (Grasshopper 0.9.76)
# plug-ins: SketchUpSharp.Grasshopper

panel = Panel("C:\Users\mthumfart\Documents\GitHub\SketchUpSharp\SketchUp\SketchupSharp\Testfiles\Untitled.skp")
sketch_up_model = SketchUpModel(Path=panel)  # -> Surfaces, Layers, Instances
sketch_up_instance = SketchUpInstance(Instance=sketch_up_model.Instances)  # -> Location, Name, Scale, Surfaces, ParentName
srf = Surface(sketch_up_model.Surfaces)
panel_2 = Panel(sketch_up_model.Layers)
