# Grasshopper definition TestDefinition.gh (Grasshopper 1.0.7)
# plug-ins: SketchUpForGrasshopper

# ----
# Get Sample File
panel = Panel("TestModel.skp")
vb = VBScript()  # -> out, A
# ---------- vb: C# ----------
    A= owner.OnPingDocument().FilePath
# ---------- end vb ----------
rep = ReplaceText(Text=vb.A, Find="TestDefinition.gh", Replace=panel, RecursiveReplace=False)

load_sketchup_model = LoadSketchUpModel(Path=rep)  # -> Surfaces, Layers, Instances, Curves, Meshes
panel_2 = Panel(load_sketchup_model.Layers)
srf = Surface(load_sketchup_model.Surfaces)
mesh = Mesh(load_sketchup_model.Meshes)
crv = Curve(load_sketchup_model.Curves)
decompose_sketchup_instance = DecomposeSketchUpInstance(Instance=load_sketchup_model.Instances)  # -> Location, Name, Scale, Surfaces, ParentName, Inner, Curves, Meshes
mesh_2 = Mesh(decompose_sketchup_instance.Meshes)
